# Grasshopper definition RDGrid.gh (Grasshopper 1.0.7)

file_path = FilePath("G:\Mi unidad\Barcelona MPDA\Universidad\2nd Semester\Algorithmics in Techonology\AT AP\GitHub\MPDA_AT.AP\RDGrid.py")
construct_domain = ConstructDomain(DomainStart=Slider(0, range=0..10), DomainEnd=Slider(10, range=0..10))
construct_domain_2 = ConstructDomain(DomainStart=Slider(0, range=0..10), DomainEnd=Slider(10, range=0..10))
read_file = ReadFile(File=file_path, PerLineParse=False)
ghpython_script = GhPythonScript(
    Code=read_file,
    Width=Slider(10, range=0..10),
    Heigth=Slider(10, range=0..10),
    Run=Toggle(False),
    XSize=construct_domain,
    YSize=construct_domain_2)  # -> Out, simplify(C), simplify(D), Mesh, Faces
panel = Panel(ghpython_script.C)
panel_2 = Panel(ghpython_script.Out)
panel_3 = Panel(ghpython_script.D)
